# Grasshopper definition Animated title.gh (Grasshopper 0.9.56)
# plug-ins: Human

crv = Curve(<curve referenced from the Rhino model>)
crv_2 = Curve([<curve referenced from the Rhino model> x22])
boundary = BoundarySurfaces(Edges=crv_2)
bbox = BoundingBox(Content=crv_2, Plane=PlaneXY(0, 0, 0), UnionBox=True)  # -> Box, Box_2
mjoin = MeshJoin(Meshes=boundary)
randpt = NRandomPoints(domain="0 to 1", seed=Slider(32, range=0..100), count="20000")
cp = ControlPoints(Curve=crv)  # -> Points, Weights, Knots
pdecon = Deconstruct(Point=randpt)  # -> XComponent, YComponent, ZComponent
slider = Slider(1, range=0..1)
box = EvaluateBox(Box=bbox.Box, UParameter=pdecon.XComponent, VParameter=pdecon.YComponent, WParameter=pdecon.ZComponent)  # -> Plane, Point, Include
meshcp = MeshClosestPoint(Point=box.Point, Mesh=mjoin)  # -> Point, Index, Parameter
dist = Distance(PointA=meshcp.Point, PointB=box.Point)
smaller = SmallerThan(FirstNumber=dist, SecondNumber="0.01")  # -> SmallerThan, OrEqualTo
graph = GraphMapper(slider, x0=0, x1=1, y0=0, y1=1, container_name="Bezier", cpx=[0, 1, 0.6859245896, 1], cpy=[0, 0.003211855888, 1, 1])
dispatch = Dispatch(List=box.Point, DispatchPattern=smaller.SmallerThan)  # -> ListA, ListB
pt = Point(dispatch.ListA)
lng = ListLength(List=pt)
multiplication = Multiplication(A=lng, B=graph)
subset = SubList(List=pt, Domain=multiplication, Wrap=True)  # -> List, Index
con = DelaunayEdges(Points=flatten([subset.List, cp.Points]), Plane=PlaneXY(0, 0, 0))  # -> Connectivity, Edges
len = Length(Curve=con.Edges)
remap = RemapNumbers(Value=len, Source="0 to 100", Target=Domain(0, 1))
gradient = Gradient(LowerLimit=0, UpperLimit=1, Parameter=remap, stops=[0: RGB(0, 0, 0), 1: RGB(255, 255, 255)])
previewlw = CustomPreviewLineweights(Geometry=con.Edges, Shader=gradient)

# ==== cluster NRandomPoints: Creates N Random Points in the domain specified
count = ClusterInput()
seed = ClusterInput()
seed_2 = Integer(seed)
count_2 = Integer(count)
domain = ClusterInput()
domain_2 = Domain(domain)
pan = Panel("""0
1
2""")
random = Random(Range=domain_2, Number=expr("N*3", count_2), Seed=seed_2)
sift = SiftPattern(List=random, SiftPattern=pan)  # -> Output0, Output1, Output2
clean = CleanTree(Data=sift.Output0, CleanInvalid=True, CleanEmpty=False)
clean_2 = CleanTree(Data=sift.Output2, CleanInvalid=True, CleanEmpty=False)
clean_3 = CleanTree(Data=sift.Output1, CleanInvalid=True, CleanEmpty=False)
pt = PointXYZ(XComponent=clean, YComponent=clean_3, ZComponent=clean_2)
pt_2 = ClusterOutput(pt)
