# Grasshopper definition Hard Shadows.gh (Grasshopper 0.9.56)

slider = Slider(4.922, range=0..20)
vec = VectorXYZ(XComponent=Slider(-0.19, range=-1..1), YComponent=Slider(-0.27, range=-1..1), ZComponent=Slider(-0.58, range=-1..1))  # -> Vector, Length
animated_geometry = AnimatedGeometry(B=slider)
geo = Geometry(flatten(animated_geometry))
xy = XYPlane(Origin=Point(0, 0, 0))
swatch = Red(SwatchColor=RGB(255, 0, 0))
mjoin = MeshJoin(Meshes=geo)
preview = CustomPreview(Geometry=geo, Shader=swatch)
mshadow = MeshShadow(Mesh=mjoin, Light=vec.Vector, Plane=xy)
max_dist_for_fade = Slider(10, range=0..10)
mjoin_2 = MeshJoin(Meshes=geo)
swatch_2 = White(SwatchColor=RGB(255, 255, 255))
swatch_3 = Black(SwatchColor=RGB(107, 107, 107))
demesh = DeconstructMesh(Mesh=mjoin_2)  # -> Vertices, Faces, Colours, Normals
mesh = Mesh(mshadow)
mjoin_3 = MeshJoin(Meshes=mesh)
demesh_2 = DeconstructMesh(Mesh=mjoin_3)  # -> Vertices, Faces, Colours, Normals
num = Number(max_dist_for_fade)
cp = ClosestPoint(Point=demesh_2.Vertices, Cloud=demesh.Vertices)  # -> ClosestPoint, CPIndex, Distance
remap = RemapNumbers(Value=cp.Distance, Source=num, Target=Domain(0, 1))
blendcol = BlendColours(ColourA=swatch_3, ColourB=swatch_2, Factor=remap)
fade_colors = MeshColours(Mesh=mjoin_3, Colours=blendcol)
solid_shadow = CustomPreview(Geometry=mesh, Shader=swatch_3)

# ==== cluster AnimatedGeometry
range = Range(Domain=Domain(0, 1), Steps=10)
B = ClusterInput()
addition = Addition(A=range, B=B)
multiplication = Multiplication(A=addition, B=Slider(2, range=0..10))
sin = Sine(Value=multiplication)
addition_2 = Addition(A="1", B=sin)
multiplication_2 = Multiplication(A=range, B=Slider(10, range=0..10))
multiplication_3 = Multiplication(A=addition_2, B=Slider(4, range=0..10))
pt = Point(Point(0.5, 0.5, 0.5))
pt_2 = ConstructPoint(XCoordinate=multiplication_2, YCoordinate=0, ZCoordinate=multiplication_3)
addition_3 = Addition(A=pt_2, B=pt)
box = Box2Pt(PointA=pt_2, PointB=addition_3, Plane=PlaneXY(0, 0, 0))
B_2 = ClusterOutput(box)
