# Grasshopper definition Matte Material Shader.gh (Grasshopper 0.9.56)

# Compare the difference in appearance between the two display shaders - one provides an even, un-shaded appearance with black linework, useful for diagramming, whereas the typical interpretation of a color in the custom preview component creates a shaded appearance.
swatch = Red(SwatchColor=RGB(255, 0, 0))
pt = Point(Point(1, 1, 1))
pt_2 = Point(Point(0, 0, 0))
box = Box2Pt(PointA=pt_2, PointB=pt, Plane=PlaneXY(0, 0, 0))
pt_3 = Point(Point(2, 0, 0))
matmat = MatteMaterialShader(col=swatch)
move = Move(Geometry=box, Motion=pt_3)  # -> Geometry, Transform
preview = CustomPreview(Geometry=move.Geometry, Shader=swatch)
preview_2 = CustomPreview(Geometry=box, Shader=matmat)

# ==== cluster MatteMaterialShader: Creates a matte openGL shader with black for diffuse and specular, and the specified color for emissive.
col = ClusterInput()
argb = SplitARGB(Colour=col)  # -> Alpha, Red, Green, Blue
swatch = Black(SwatchColor=RGB(0, 0, 0))
subtraction = Subtraction(A=1, B=argb.Alpha)
col_2 = Colour(col)
material = CreateMaterial(Diffuse=swatch, Specular=swatch, Emission=col_2, Transparency=subtraction, Shine=0)
M = ClusterOutput(material)
