# Grasshopper definition Soft Shadows.gh (Grasshopper 0.9.56)

slider = Slider(5.069, range=0..20)
enable_shadow_display = BooleanToggle(True)
resolution_of_shadow = Slider(0.34, range=0..10)
extend_shadow_plane = Slider(19, range=0..100)
animated_geometry = AnimatedGeometry(B=slider)
geo = Geometry(flatten(animated_geometry))
filter = StreamFilter(Gate=enable_shadow_display, Stream1=geo)
project = Project(Geometry=filter, Plane=PlaneXY(0, 0, 0))  # -> Geometry, Transform
custom_mesh_settings = SettingsCustom(
    StitchSeams=True,
    SimplePlanes=False,
    Refine=True,
    MinCount=16,
    MaxCount=400,
    AspectRatio=20,
    MaxDistance=0,
    MaxAngle=20,
    MinEdge=0,
    MaxEdge=resolution_of_shadow)
mesh = MeshBrep(Brep=filter, Settings=custom_mesh_settings)
bbox = BoundingBox(Content=project.Geometry, Plane=PlaneXY(0, 0, 0), UnionBox=True)  # -> Box, Box_2
min_dist_for_shadow = Slider(0, range=0..10)
swatch = Black(SwatchColor=RGB(255, 255, 255))
max_dist_for_shadow = Slider(8, range=0..100)
swatch_2 = Black(SwatchColor=RGB(0, 0, 0))
offbox = OffBox(B=bbox.Box, O=extend_shadow_plane)
mjoin = MeshJoin(Meshes=mesh)
background_color = Colour(swatch)
shadow_color = Colour(swatch_2)
srf = Srf(offbox)
mesh_2 = MeshBrep(Brep=srf, Settings=custom_mesh_settings)
dom = ConstructDomain(DomainStart=min_dist_for_shadow, DomainEnd=max_dist_for_shadow)
demesh = DeconstructMesh(Mesh=mjoin)  # -> Vertices, Faces, Colours, Normals
demesh_2 = DeconstructMesh(Mesh=mesh_2)  # -> Vertices, Faces, Colours, Normals
cp = ClosestPoint(Point=demesh_2.Vertices, Cloud=demesh.Vertices)  # -> ClosestPoint, CPIndex, Distance
bnd = Bounds(Numbers=cp.Distance)
not = GateNot(A=enable_shadow_display)
remap = RemapNumbers(Value=cp.Distance, Source=dom, Target=Domain(0, 1))
graph = GraphMapper(remap, x0=0, x1=1, y0=0, y1=1, container_name="Bezier", cpx=[0, 0, 0.3022699654, 1], cpy=[0, 1, 1, 1])
setbackgroundcolor = SetBackgroundColor(
    D=not,
    B=background_color,
    G="false",
    TooltipTextOverride="Display Options",
    TooltipDescriptionOverride="Manage background color and Grid settings of Rhino")  # -> out; inputs B: Color
# ---------- setbackgroundcolor: VB ----------
    If D = True Then
      Rhino.ApplicationSettings.AppearanceSettings.ViewportBackgroundColor = Color.FromArgb(0, 157, 163, 170)
    Else
      Rhino.ApplicationSettings.AppearanceSettings.ViewportBackgroundColor = B
    End If
    If G = False And D = False Then
      Rhino.ApplicationSettings.AppearanceSettings.GridThickLineColor = B
      Rhino.ApplicationSettings.AppearanceSettings.GridThinLineColor = B
      Rhino.ApplicationSettings.AppearanceSettings.GridXAxisLineColor = B
      Rhino.ApplicationSettings.AppearanceSettings.GridYAxisLineColor = B
      Rhino.ApplicationSettings.AppearanceSettings.GridZAxisLineColor = B
    Else If G = False And D = True Then
      Rhino.ApplicationSettings.AppearanceSettings.GridThickLineColor = Color.FromArgb(0, 157, 163, 170)
      Rhino.ApplicationSettings.AppearanceSettings.GridThinLineColor = Color.FromArgb(0, 157, 163, 170)
      Rhino.ApplicationSettings.AppearanceSettings.GridXAxisLineColor = Color.FromArgb(0, 157, 163, 170)
      Rhino.ApplicationSettings.AppearanceSettings.GridYAxisLineColor = Color.FromArgb(0, 157, 163, 170)
      Rhino.ApplicationSettings.AppearanceSettings.GridZAxisLineColor = Color.FromArgb(0, 157, 163, 170)  
    Else
      Rhino.ApplicationSettings.AppearanceSettings.GridThickLineColor = Color.FromArgb(0, 129, 134, 140)
      Rhino.ApplicationSettings.AppearanceSettings.GridThinLineColor = Color.FromArgb(0, 147, 153, 160)
      Rhino.ApplicationSettings.AppearanceSettings.GridXAxisLineColor = Color.FromArgb(0, 150, 75, 75)
      Rhino.ApplicationSettings.AppearanceSettings.GridYAxisLineColor = Color.FromArgb(0, 75, 150, 75)
      Rhino.ApplicationSettings.AppearanceSettings.GridZAxisLineColor = Color.FromArgb(0, 75, 75, 150)
    End If
# ---------- end setbackgroundcolor ----------
blendcol = BlendColours(ColourA=shadow_color, ColourB=background_color, Factor=graph)
mcol = MeshColours(Mesh=mesh_2, Colours=blendcol)

# ==== cluster AnimatedGeometry
B = ClusterInput()
range = Range(Domain=Domain(0, 1), Steps=10)
addition = Addition(A=range, B=B)
multiplication = Multiplication(A=addition, B=Slider(2, range=0..10))
sin = Sine(Value=multiplication)
addition_2 = Addition(A="1", B=sin)
multiplication_2 = Multiplication(A=range, B=Slider(10, range=0..10))
multiplication_3 = Multiplication(A=addition_2, B=Slider(4, range=0..10))
pt = Point(Point(0.5, 0.5, 0.5))
pt_2 = ConstructPoint(XCoordinate=multiplication_2, YCoordinate=0, ZCoordinate=multiplication_3)
addition_3 = Addition(A=pt_2, B=pt)
box = Box2Pt(PointA=pt_2, PointB=addition_3, Plane=PlaneXY(0, 0, 0))
B_2 = ClusterOutput(box)

# ==== cluster OffBox
B = ClusterInput()
O = ClusterInput()
B_2 = Box(B)
O_2 = Number(O)
debox = DeconstructBox(Box=B_2)  # -> Plane, X, Y, Z
num = Number(debox.Z)
num_2 = Number(debox.Y)
num_3 = Number(debox.X)
addition = Addition(A=num, B=O_2)
addition_2 = Addition(A=num_3, B=O_2)
addition_3 = Addition(A=num_2, B=O_2)
box = EvaluateBox(Box=B_2, UParameter=0.5, VParameter=0.5, WParameter=0.5)  # -> Plane, Point, Include
division = Division(A=addition_2, B=num_3)
division_2 = Division(A=addition_3, B=num_2)
division_3 = Division(A=addition, B=num)
nullrep = ReplaceNulls(Items=division, Replacements="1")  # -> Items, Count
nullrep_2 = ReplaceNulls(Items=division_2, Replacements="1")  # -> Items, Count
nullrep_3 = ReplaceNulls(Items=division_3, Replacements="1")  # -> Items, Count
scale_nu = ScaleNU(Geometry=B_2, Plane=box.Point, ScaleX=nullrep.Items, ScaleY=nullrep_2.Items, ScaleZ=nullrep_3.Items)  # -> Geometry, Transform
G = ClusterOutput(scale_nu.Geometry)
