# Grasshopper definition Unroll Brep.gh (Grasshopper 0.9.56)

# This script reproduces the "unrollsrf" command - it will unroll a BRep along with associated points and curves.
unroll_brep = UnrollBrep()  # -> out, B, C, P; inputs Brep: Brep, Curves: list of Curve, Points: list of Point3d
# ---------- unroll_brep: C# ----------
    if(Brep != null){
      Unroller unroller = new Unroller(Brep);
      unroller.AddFollowingGeometry(Curves);
      unroller.AddFollowingGeometry(Points);
      TextDot[] dots;
      Point3d[] pts;
      Curve[] unrolledCrvs;
      B = unroller.PerformUnroll(out unrolledCrvs, out pts, out dots);
      C = unrolledCrvs;
      P = pts;
    }
# ---------- end unroll_brep ----------
